# Grasshopper definition 240130_ClosestPoints_LH.gh (Grasshopper 1.0.7)

number_slider = Slider(7, range=0..10)
msphere = MeshSphere(Base=PlaneXY(0, 0, 0), Radius=Slider(0.5, range=0..1), UCount=number_slider, VCount=number_slider)

# ---- group: sphere
mesh = Mesh(msphere)

# ---- group: Bunny
bunny_mesh = Mesh(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)

# ----
python = GhPythonScript(iMesh=mesh, index=Slider(1, range=0..10), size=Slider(3, range=0..10))  # -> out, a, b, c; inputs iMesh: Mesh, index: Int32, size: Int32
# ---------- python: Python ----------
import Rhino.Geometry as rg
import math

#get the points from an input mesh:
def GetParticles(mesh):
    # quadrangulate mesh
    #mesh.QuadRemesh(rg.QuadRemeshParameters())
    #triangulate mesh:
    mesh.Faces.ConvertQuadsToTriangles()
    
    #get vertices
    vertices = mesh.Vertices.ToPoint3dArray()
    points = []
    for i in range(len(vertices)):
        point = rg.Point3d( vertices[i].X, vertices[i].Y, vertices[i].Z)
        
        points.append(point) 

    return points

#establish a relationship to convert to springs:
def GetMeshEdges(mesh):

    mesh.Faces.ConvertQuadsToTriangles
    points = GetParticles(mesh)
    topos = mesh.TopologyEdges
    edges = []
    
    for t in range(topos.Count):
        vertex_i = mesh.TopologyEdges.GetTopologyVertices(t)
        ab = rg.Line(mesh.Vertices[vertex_i[0]], mesh.Vertices[vertex_i[1]])
        edges.append(ab)


    return edges

#create a dictionary for points and their surrounding edges:
def GetMeshNetwork(mesh, size):

    points = GetParticles(mesh)
    vertex_distances = {}

    list_size = size

    for i in points:
        distances = []

        for j in points:
            if i != j:
                distance = j.DistanceTo(i)
                distances.append((j, distance))

        distances.sort(key=lambda x: x[1])

        closest_points = []

        for d in distances[:list_size]:
            closest_points.append(d[0])

        vertex_distances[i] = closest_points

    return vertex_distances

# Main script
x = GetMeshNetwork(iMesh, size)
vertex = list(x.keys())
print type(vertex)

print len(vertex)

a = GetMeshEdges(iMesh)
# ---------- end python ----------
preview = CustomPreview(Geometry=python.a, Material=ColourSwatch(SwatchColor=RGB(255, 0, 0)))
preview_2 = CustomPreview(Geometry=python.c, Material=ColourSwatch(SwatchColor=RGB(0, 255, 51)))

# ---- group: Extract Topology
number_slider_2 = Slider(1, range=0..10)
number_slider_3 = Slider(3, range=0..10)
python_2 = GhPythonScript(iMesh=mesh)  # -> out, a, b, c; inputs iMesh: Mesh
# ---------- python_2: Python ----------
import Rhino.Geometry as rg
import math

#get the points from an input mesh:
def GetParticles(mesh):
    # quadrangulate mesh
    #mesh.QuadRemesh(rg.QuadRemeshParameters())
    #triangulate mesh:
    mesh.Faces.ConvertQuadsToTriangles()
    
    #get vertices
    vertices = mesh.Vertices.ToPoint3dArray()
    points = []
    for i in range(len(vertices)):
        point = rg.Point3d( vertices[i].X, vertices[i].Y, vertices[i].Z)
        
        points.append(point) 

    return points

#establish a relationship to convert to springs:
def GetMeshVertices(mesh):

    indices = mesh.TopologyVertices
    indicesCount = len(indices)

    distances = []

    for i in range(1, indicesCount):
        d = indices[i-1].DistanceTo(indices[i])
        distances.append(d)

    
    points = []
    for i in range(indicesCount):
        point = rg.Point3d(indices[i].X, indices[i].Y, indices[i].Z,)
        points.append(point)
    

    return points

def GetVerticesDict(mesh):

    ivertex = mesh.TopologyVertices #get topology vertex indices from GetMeshVertices method 
    
    d = {} #empty dictionary for vertex indices
    dpoints = {} #empty dictionary for related points
    
    for i in range(ivertex.Count):
        connected_vertices_idx = ivertex.ConnectedTopologyVertices(i)
        connected_vertices = []
        
        
        for idx in range(len(connected_vertices_idx)):
            connected_vertices.append(mesh.Vertices[connected_vertices_idx[idx]])
            
            d[mesh.Vertices[i]] = connected_vertices
            dpoints[i] = connected_vertices_idx
        
        
        
        
    #for ivertex, connected_vertex in d.items():
    
        #vertices = []
    
        #for ivertex in connected_vertices:
            #vpoint = rg.Point3d(mesh.Vertices[ivertex].X, mesh.Vertices[ivertex].Y, mesh.Vertices[ivertex].Z)
            #vertices.append(vpoint)
        
    #dpoints[ivertex] = vertices
        
    return d
    

a = GetVerticesDict(iMesh)

#print a.keys()
# ---------- end python_2 ----------
preview_3 = CustomPreview(Geometry=python_2.a, Material=ColourSwatch(SwatchColor=RGB(0, 255, 51)))

# ---- group: get mesh edges
python_3 = GhPythonScript(iMesh=mesh)  # -> out, a, b; inputs iMesh: Mesh
# ---------- python_3: Python ----------
import Rhino.Geometry as rg
import math

#get the points from an input mesh:
def GetParticles(mesh):
    # quadrangulate mesh
    #mesh.QuadRemesh(rg.QuadRemeshParameters())
    #triangulate mesh:
    mesh.Faces.ConvertQuadsToTriangles()
    
    #get vertices
    vertices = mesh.Vertices.ToPoint3dArray()
    points = []
    for i in range(len(vertices)):
        point = rg.Point3d( vertices[i].X, vertices[i].Y, vertices[i].Z)
        
        points.append(point) 

    return points

#establish a relationship to convert to springs:
def GetMeshEdges(mesh):
    mesh.Faces.ConvertQuadsToTriangles
    points = GetParticles(mesh)
    topos = mesh.TopologyEdges
    edges = []
    
    for t in range(topos.Count):
        vertex_i = mesh.TopologyEdges.GetTopologyVertices(t)
        ab = rg.Line(mesh.Vertices[vertex_i[0]], mesh.Vertices[vertex_i[1]])
        edges.append(ab)


    return edges



a = GetMeshEdges(iMesh)
# ---------- end python_3 ----------

# ----
python_4 = GhPythonScript(iMesh=mesh)  # -> out, b, c; inputs iMesh: Mesh
# ---------- python_4: Python ----------
import Rhino.Geometry as rg
import math

#get the points from an input mesh:
def GetParticles(mesh):
    # quadrangulate mesh
    #mesh.QuadRemesh(rg.QuadRemeshParameters())
    #triangulate mesh:
    mesh.Faces.ConvertQuadsToTriangles()
    
    #get vertices
    vertices = mesh.Vertices.ToPoint3dArray()
    points = []
    for i in range(len(vertices)):
        point = rg.Point3d( vertices[i].X, vertices[i].Y, vertices[i].Z)
        
        points.append(point) 

    return points

#establish a relationship to convert to springs:
def GetMeshEdges(mesh):
    mesh.Faces.ConvertQuadsToTriangles
    points = GetParticles(mesh)
    topos = mesh.TopologyEdges
    edges = []
    
    for t in range(topos.Count):
        vertex_i = mesh.TopologyEdges.GetTopologyVertices(t)
        ab = rg.Line(mesh.Vertices[vertex_i[0]], mesh.Vertices[vertex_i[1]])
        edges.append(ab)


    return edges

#create a dictionary for points and their surrounding edges:
def GetMeshNetwork(mesh, size):
    
    points = GetParticles(mesh)
    ddistances = {} #dictionary for points and relative distance
    
    list_size = size
    
    for i in points:
        distances = [] #list of distances to point
        for j in points:
            if i != j:
                distance = j.DistanceTo(i)
                distances.append((j,distance))

        distances.sort(key = lambda x: x[1]) 
        
        closest_points = []
        
        for closest in distances[:list_size]:
            closest_points.append(closest[0])
            
        ddistances[i] = closest_points
        
        return ddistances
# ---------- end python_4 ----------
geo = Geometry(python_3.a)
panel = Panel(python_2.c)

# ---- group: LH - Springs
number_slider_4 = Slider(6, range=0..10)
box = CenterBox(Base=PlaneXY(0, 0, 0), X=number_slider_4, Y=number_slider_4, Z=number_slider_4)
pop3d = Populate3D(Region=box, Count=Slider(5, range=0..10), Seed=1)
pt = Point(pop3d)
trigger = Trigger(Interval=100, TimerInterval=100, Target=python_5)  # disabled
python_5 = GhPythonScript(iReset=Button(), pts=python.a)  # -> out, oGeo; inputs iReset: Boolean, pts: list of Point3d
# ---------- python_5: Python ----------
__author__ = "Medion Erazer"
__version__ = "2024.01.29"

import rhinoscriptsyntax as rs
import Rhino.Geometry as rg

# prepare dictionary
d = {}

for i in pts:
    l = []
    for j in pts:
        if i != j:
            l.append(j)
        d[i] = l

########## Input as dictionary ##########
########## Key: central point  ##########
########## Value: close point  ##########
class Spring_system:
    def __init__(self,i_dict):
        self.springs = []
        for cen_pt in list(i_dict.keys()):
            # Origin velocity: sum all the vectors
            v = rg.Vector3d(0,0,0)
            for clo_pt in i_dict[cen_pt]:
                v_s = rg.Vector3d(cen_pt)-rg.Vector3d(clo_pt)
                v += v_s
                v.Unitize()
            # Initialize spring
            i_spring = Spring(cen_pt,i_dict[cen_pt],v)
            self.springs.append(i_spring)

    def Update(self):
        for i_spring in self.springs:
            i_steer = i_spring.Steer()
            i_spring.Update(i_steer)
            
    def Show(self):
        sys_pts = []
        sys_line = []
        for i_spring in self.springs:
            sys_pts.append(i_spring.start)
        
        for i in sys_pts:
            for j in sys_pts:
                if i != j:
                    sys_line.append(rg.Line(i,j))
        return sys_line


class Spring:
    ########## Create spring based on two end points ##########
    def __init__(self,cen_pt,clo_pts,v):
        self.start = cen_pt
        
        self.end = []
        self.o_lens = []
        
        for pt in clo_pts:
            self.end.append(pt)
        for i in range(len(self.end)):
            self.o_lens.append(self.start.DistanceTo(self.end[i]))
            
        self.start_velocity = v
        
    ########## Update the new position of end points ##########
    def Update(self,steer):
        self.start_velocity = self.start_velocity+steer
        self.start += self.start_velocity
        
    ########## Calculate spring force based on distance between two end points ##########
    def Steer(self):
        steer_list = []
        for i in range(len(self.end)):
            n_length = self.start.DistanceTo(self.end[i])
            delta = n_length - self.o_lens[i]
            dir = rg.Vector3d(self.end[i])-rg.Vector3d(self.start)
            dir.Unitize()
            
            if delta > 0:
                single = dir*0.02*delta
            else:
                single = dir*0.02*delta
            
            steer_list.append(single)
            
        steer = rg.Vector3d(0,0,0)
        for single in steer_list:
            steer += single
        return steer
        
    def Show(self):
        show_line = []
        for pt in self.end:
            line = rg.Line(self.start,pt)
            show_line.append (line)
        return show_line

if iReset:
    my_system = Spring_system(d)
else:
    my_system.Update()
    oGeo = my_system.Show()
# ---------- end python_5 ----------
line = Line(python_5.oGeo)
